# Grasshopper definition CreateWall.gh (Grasshopper 1.0.7)
# plug-ins: BasementWall

brep = Brep([<brep referenced from the Rhino model> x4])
brep_2 = Brep(<brep referenced from the Rhino model>)
brep_3 = Brep(<brep referenced from the Rhino model>)
brep_4 = Brep([<brep referenced from the Rhino model> x16])
brep_5 = Brep([<brep referenced from the Rhino model> x16])
bw = BasementWall(Wall=brep_4, Thickness=Slider(400, range=0..1000), Offset=Slider(0, range=0..1000))  # -> Wall, Wall_2
S = BasementSolid(GroundSurface=brep_3, WaterLevel=Slider(4500, range=0..10000))
bw_2 = BasementWall(Wall=brep_5, Thickness=Slider(300, range=0..1000), Offset=Slider(50, range=-100..1000))  # -> Wall, Wall_2
bs = BasementSlab(Slab=brep, Thickness=Slider(150, range=0..1000))  # -> SlabBrep, Slab
bs_2 = BasementSlab(Slab=brep_2, Thickness=Slider(400, range=0..1000))  # -> SlabBrep, Slab
bs_3 = Basement(Elements=[bw.Wall_2, bw_2.Wall_2, bs_2.Slab, bs.Slab, S])
